# Dynamo graph AI constructor test - load.dyn (Dynamo 1.3.0.875)

file_path = Filename(".\AI constructor test.json")
loadModel = AI.Machine.RegressionMachine.LoadModel(file_path)
GUID = AI.Machine.RegressionMachine.GUID(loadModel)
algorithm = AI.Machine.RegressionMachine.Algorithm(loadModel)
description = AI.Machine.RegressionMachine.Description(loadModel)
name = AI.Machine.RegressionMachine.Name(loadModel)
learned = AI.Machine.RegressionMachine.Learned(loadModel)
